# Grasshopper definition anySurfaceCalculation.gh (Grasshopper 1.0.7)
# plug-ins: SpaceFactory

number_slider = Slider(50, range=0..100)
unit_z = UnitZ(Factor=1)
surface = Surface(<surface referenced from the Rhino model>)
divide_surface = DivideSurface(Surface=surface, UCount=number_slider, VCount=number_slider)  # -> Points, Normals, Parameters
boolean_toggle = BooleanToggle(True)
contour = Contour(Shape=surface, Point=Point(0, 0, 0), Direction=unit_z, Distance=Slider(100, range=0..100))
clean_tree = CleanTree(RemoveNulls=boolean_toggle, RemoveInvalid=boolean_toggle, RemoveEmpty=boolean_toggle, Tree=divide_surface.Points)
clean_tree_2 = CleanTree(RemoveNulls=boolean_toggle, RemoveInvalid=boolean_toggle, RemoveEmpty=boolean_toggle, Tree=divide_surface.Normals)
uvtocontours = UVtoContours(Contours=flatten(contour), Points=flatten(clean_tree), Normals=flatten(clean_tree_2), Length=Slider(200, range=0..1000))  # -> Points, Normals
mapnormal = MapNormal(Points=uvtocontours.Points, Normals=uvtocontours.Normals, Threshold=Slider(30, range=0..100), Support=Toggle(True))  # -> PositivePoints, PositiveAngles, NegativePoints, NegativeAngles
sort_list = SortList(Keys=mapnormal.PositiveAngles)  # -> Keys, ValuesValuesA
sort_list_2 = SortList(Keys=mapnormal.NegativeAngles, ValuesValuesA=mapnormal.NegativePoints)  # -> Keys, ValuesValuesA
list_item = ListItem(List=sort_list.Keys, Index=0, Wrap=True)
list_item_2 = ListItem(List=sort_list.Keys, Index="-1", Wrap=True)
list_item_3 = ListItem(List=sort_list_2.Keys, Index=0, Wrap=True)
list_item_4 = ListItem(List=sort_list_2.Keys, Index="-1", Wrap=True)
list_item_5 = ListItem(List=sort_list_2.ValuesValuesA, Index="-1", Wrap=True)
gradient = Gradient(
    LowerLimit=list_item,
    UpperLimit=list_item_2,
    Parameter=mapnormal.PositiveAngles,
    stops=[0: RGB(0, 98, 0), 0.25: RGB(81, 175, 17), 0.5: RGB(159, 198, 146), 0.75: RGB(170, 235, 41), 1: RGB(221, 255, 53)])
gradient_2 = Gradient(
    LowerLimit=list_item_3,
    UpperLimit=list_item_4,
    Parameter=mapnormal.NegativeAngles,
    stops=[0: RGB(255, 228, 54), 1: RGB(220, 0, 40), 1: RGB(196, 24, 12)])
curve = Curve(contour)
custom_preview = CustomPreview(Geometry=curve, Material=ColourSwatch(SwatchColor=RGB(158, 208, 255)))
custom_preview_2 = CustomPreview(Geometry=mapnormal.PositivePoints, Material=gradient)
custom_preview_3 = CustomPreview(Geometry=mapnormal.NegativePoints, Material=gradient_2)
text_tag = TextTag(Location=list_item_5, Text=list_item_4, Colour=ColourSwatch(SwatchColor=RGB(255, 255, 255)))
